# Grasshopper definition ExportMeshAsIndizes.gh (Grasshopper 0.9.14)

mesh = Mesh(<mesh referenced from the Rhino model>)
mcomp = Decompose(Mesh=mesh)  # -> Vertices, Faces, Colours, Normals
pcomp = Decompose(Point=mcomp.Vertices, System=PlaneXY(0, 0, 0))  # -> XComponent, YComponent, ZComponent
rep = ReplaceString(String=mcomp.Faces, Find="{")
int = Integer(pcomp.XComponent)
int_2 = Integer(pcomp.YComponent)
int_3 = Integer(pcomp.ZComponent)
rep_2 = ReplaceString(String=rep, Find="}")
num = Number(int)
num_2 = Number(int_2)
num_3 = Number(int_3)
pt = PointXYZ(XComponent=num, YComponent=num_2, ZComponent=num_3, System=PlaneXY(0, 0, 0))
rep_3 = ReplaceString(String=pt, Find="{")
rep_4 = ReplaceString(String=rep_3, Find="}")
rep_5 = ReplaceString(String=rep_2, Find="T")
merge = Merge(Data1=graft(num), Data2=graft(num_2), Data3=graft(num_3))  # -> flatten(Result)
rep_6 = ReplaceString(String=rep_5, Find=";", Replace=",")
concat = Concatenate(A=rep_4, B=",")  # -> flatten(Result)
concat_2 = Concatenate(A=rep_6, B=",")  # -> flatten(Result)
rep_7 = ReplaceString(String=rep_4, Find=",")  # -> flatten(Result)
rep_8 = ReplaceString(String=rep_6, Find=",")  # -> flatten(Result)
faceindices = Panel(rep_8)
vertices = Panel(merge)
